# Grasshopper definition Demo_simple.gh (Grasshopper 1.0.7)
# plug-ins: GhGLTF Info

center_box = CenterBox(Base=PlaneXY(0, 0, 0), X=1, Y=1, Z=1)
mesh_brep = MeshBrep(
    Brep=center_box,
    Settings={GridMaxCount=0, GridMinCount=16, JaggedSeams=False, MaxEdgeLength=0, MinEdgeLength=0.0001, MinTolerance=0, Refine=True, RefineAngle=0, RelativeTolerance=0.65, SimplePlanes=True, Tolerance=0})
file_path = FilePath("/Users/mnmly/Downloads/demo-simple.gltf")
export_as_gltf = ExportAsGlTF(Geometry=mesh_brep, OutputPath=file_path, FlipAxis=True, CurveResolutionFactor=0.2)
